# Grasshopper definition hello_test.gh (Grasshopper 1.0.8)

get_string = GetString("Shen", AtLeast=1, AtMost=1, TreeAccess=False)
concatenate = Concatenate(Fragment_A="hello ", Fragment_B=get_string, A="!")
panel = Panel(concatenate)
context_print = ContextPrint(Text=panel)
