# Grasshopper definition hops_test.gh (Grasshopper 1.0.8)

get_number = GetNumber(Slider(0.3, range=0..1), AtLeast=1, AtMost=1, Maximum=1.797693135e+308, Minimum=-1.797693135e+308, TreeAccess=False)
get_number_2 = GetNumber(Slider(0, range=0..1), AtLeast=1, AtMost=1, Maximum=1.797693135e+308, Minimum=-1.797693135e+308, TreeAccess=False)
addition = Addition(A=get_number, B=get_number_2)
maximum = Maximum(A=addition, B="0")
panel = Panel(maximum)
context_print = ContextPrint(Text=maximum)
